# Grasshopper definition Folding Tower.gh (Grasshopper 1.0.7)
# plug-ins: Heteroptera

# Input Curve
number_slider = Slider(32, range=0..100)
rectangle = Rectangle(Plane=PlaneXY(0, 0, 0), XSize=number_slider, YSize=number_slider, Radius=0)  # -> Rectangle, Length
input_curve = Curve(<curve referenced from the Rhino model>)  # disabled
data = Data(rectangle.Rectangle)

# ---- group: Rectangles rotation / Roof angle
number_slider_2 = Slider(20, range=0..100)

# ----
Z = UnitZ(Factor=1)

# ---- group: Level height
number_slider_3 = Slider(4, range=0..10)

# ---- group: Facade / Pas montanti
number_slider_4 = Slider(1.5, range=0..10)

# ----
toggle = BooleanToggle(False)

# ---- group: Facade / Adancime montanti
number_slider_5 = Slider(0.3, range=0..1)

# ---- group: Facade / Latime montanti/2
number_slider_6 = Slider(0.025, range=0..0.1)

# ---- group: Rectangles rotation
merge = Merge(
    Data1=Slider(0, range=0..100),
    Data2=Slider(5, range=0..10),
    Data3=Slider(16, range=0..100),
    Data4=Slider(30, range=0..100),
    Data5=Slider(40, range=0..100))
multiplication = Multiplication(A=merge, B=4)
unghi_rotire_placa = Slider(15, range=0..100)
lng = ListLength(List=multiplication)  # -> expr("x-1", Length)
Z_2 = UnitZ(Factor=multiplication)
move = Move(Geometry=data, Motion=Z_2)  # -> Geometry, Transform
series = Series(Start=expr("-x", unghi_rotire_placa), Step=expr("0", 1), Count=lng)
series_2 = Series(Start=expr("0", 0), Step=expr("0", 1), Count=lng)
weave = Weave(Pattern=[0, 1], Stream0=series_2, Stream1=series, NullGaps=False)
split = SplitList(List=weave, Index=expr("x+1", lng))  # -> ListA, ListB
neg = Negative(Value=Slider(9, range=0..10))
offset = OffsetCurve(Curve=data, Distance=neg, Plane=PlaneXY(0, 0, 0), Corners=1)

# ----
center = Center(Geometric=move.Geometry)  # -> Center, Dimension

# ---- group: Rectangles rotation (continued)
xy = XYPlane(Origin=center.Center)
# Starting rectangles
rotate = Rotate(Geometry=move.Geometry, Angle=degrees(split.ListA), Plane=xy)  # -> Geometry, Transform
item = ListItem(List=rotate.Geometry, Index=-1, Wrap=True)

# ----
center_2 = Center(Geometric=item)  # -> Center, Dimension
xy_2 = XYPlane(Origin=center_2.Center)
xz = XZPlane(Origin=center_2.Center)
rotate_2 = Rotate(Geometry=xz, Angle=degrees(1.570796327), Plane=xy_2)  # -> Geometry, Transform

# ---- group: Rectangles rotation (continued)
rotate_3 = Rotate(Geometry=item, Angle=expr("-x", degrees(number_slider_2)), Plane=rotate_2.Geometry)  # -> Geometry, Transform
offset_2 = OffsetCurve(Curve=rotate_3.Geometry, Distance=neg, Plane=rotate_3.Geometry, Corners=1)

# ----
projecta = ProjectAlong(Geometry=item, Plane=rotate_3.Geometry, Direction=Z)  # -> Geometry, Transform

# ---- group: Rectangles rotation (continued)
replace = ReplaceItems(List=rotate.Geometry, Item=projecta.Geometry, Indices=lng, Wrap=False)
trim = TrimTree(Tree=replace, Depth=Slider(3, range=0..10))

# ---- group: Core
loft = Loft(
    Curves=flatten([offset, offset_2]),
    Options={Adjust=False, Closed=False, LoftEnds=0, LoftSimp=0, LoftType=0, Rebuild=10, Refit=0.01})

# ---- group: Inner skin
debrep = DeconstructBrep(Brep=trim)  # -> Faces, Edges, Vertices
graft = GraftTree(Tree=debrep.Vertices, IncludeEmptyLists=True, IncludeNullItems=True)
flip = FlipMatrix(Data=debrep.Vertices)
simplify = SimplifyTree(Tree=graft, Front=False)
relitem = RelativeItem(Tree=simplify, Offset="{1;-1}", WrapPaths=invert(False), WrapItems=False)  # -> ItemA, ItemB
relitem_2 = RelativeItem(Tree=simplify, Offset="{1;1}", WrapPaths=invert(False), WrapItems=False)  # -> ItemA, ItemB
ln = Line(StartPoint=relitem.ItemA, EndPoint=relitem.ItemB)
ln_2 = Line(StartPoint=relitem_2.ItemA, EndPoint=relitem_2.ItemB)
trim_2 = TrimTree(Tree=ln, Depth=1)
trim_3 = TrimTree(Tree=ln_2, Depth=1)
# Main geometry
viewer = ParamViewer(trim_3)
viewer_2 = ParamViewer(trim_2)
pline = PolyLine(Vertices=flip, Closed=False)
cull_i = CullIndex(List=viewer, Indices="-1", Wrap=True)
cull_i_2 = CullIndex(List=viewer_2, Indices="-1", Wrap=True)
explode = Explode(Curve=pline, Recursive=True)  # -> Segments, Vertices
flip_2 = FlipMatrix(Data=explode.Segments)  # -> simplify(Data)
branch = TreeBranch(Tree=trim_3, Path=cull_i, MaintainPaths=True)
branch_2 = TreeBranch(Tree=trim_2, Path=cull_i_2, MaintainPaths=True)
end = EndPoints(Curve=branch)  # -> Start, End
end_2 = EndPoints(Curve=flip_2)  # -> Start, End
end_3 = EndPoints(Curve=branch_2)  # -> Start, End
shift = ShiftList(List=end_2.Start, Shift=1, Wrap=True)  # -> simplify(List)
shift_2 = ShiftList(List=end_3.Start, Shift=1, Wrap=True)  # -> simplify(List)
shift_3 = ShiftList(List=end_3.End, Shift=1, Wrap=True)  # -> simplify(List)
srf4pt = _4PointSurface(CornerA=shift, CornerB=end.Start, CornerC=end.End)
srf4pt_2 = _4PointSurface(CornerA=end_2.End, CornerB=end.End, CornerC=end.Start)
srf4pt_3 = _4PointSurface(CornerA=end_2.End, CornerB=end_3.End, CornerC=end_3.Start)
srf4pt_4 = _4PointSurface(CornerA=end_2.Start, CornerB=shift_2, CornerC=shift_3)
shift_4 = ShiftList(List=srf4pt_3, Shift=1, Wrap=True)  # -> simplify(List)
panel = Panel("""0
1""")
viewer_3 = ParamViewer(srf4pt_2)
viewer_4 = ParamViewer(srf4pt)
viewer_5 = ParamViewer(srf4pt_4)
viewer_6 = ParamViewer(shift_4)
cull = CullPattern(List=viewer_4, CullPattern=invert(panel))
cull_2 = CullPattern(List=viewer_3, CullPattern=invert(panel))
cull_3 = CullPattern(List=viewer_5, CullPattern=panel)
cull_4 = CullPattern(List=viewer_6, CullPattern=panel)
branch_3 = TreeBranch(Tree=srf4pt, Path=cull, MaintainPaths=False)
branch_4 = TreeBranch(Tree=srf4pt_2, Path=cull_2, MaintainPaths=False)
branch_5 = TreeBranch(Tree=srf4pt_4, Path=cull_3, MaintainPaths=False)
branch_6 = TreeBranch(Tree=shift_4, Path=cull_4, MaintainPaths=False)
path_mapper = PathMapper(branch_5, source="{a}", target="{a*4}")
path_mapper_2 = PathMapper(branch_6, source="{a}", target="{a*4}")
path_mapper_3 = PathMapper(branch_3, source="{a}", target="{a*4}")
path_mapper_4 = PathMapper(branch_4, source="{a}", target="{a*4}")
path_mapper_5 = PathMapper(path_mapper, source="{a}", target="{a+2}")
path_mapper_6 = PathMapper(path_mapper_2, source="{a}", target="{a+3}")
path_mapper_7 = PathMapper(path_mapper_4, source="{a}", target="{a+1}")
merge_2 = Merge(Data1=path_mapper_3, Data2=path_mapper_7, Data3=path_mapper_5, Data4=path_mapper_6)

# ----
split_2 = SplitList(List=merge_2, Index=4)  # -> ListA, ListB
path_mapper_8 = PathMapper(split_2.ListB, source="{a;b}", target="{a;b+1}")
merge_3 = Merge(Data1=split_2.ListA, Data2=path_mapper_8)

join = BrepJoin(Breps=merge_3)  # -> Breps, Closed
join_2 = BrepJoin(Breps=flatten(join.Breps))  # -> Breps, Closed
cap = CapHoles(Brep=join_2.Breps)
neg_2 = Negative(Value=Slider(0.2, range=0..1))
# Floors
contour = Contour(Shape=cap, Point=Point(0, 0, 0), Direction=Vector(0, 0, 1), Distance=number_slider_3)
Z_3 = UnitZ(Factor=neg_2)
boundary = BoundarySurfaces(Edges=contour)
extr = Extrude(Base=boundary, Direction=Z_3)
merge_4 = Merge(Data1=extr, Data2=loft)

# ---- group: Outer skin
len = Length(Curve=data)
bbox = BoundingBox(Content=merge_3, Plane=PlaneXY(0, 0, 0), UnionBox=True)  # -> Box, Box_2
debrep_2 = DeconstructBrep(Brep=bbox.Box)  # -> Faces, Edges, Vertices
item_2 = ListItem(List=debrep_2.Faces, Index=4, Wrap=True)
expression = Expression(x=len, y=Slider(1.2, range=0..10), Expression="(x/4+y)/(x/4)")
area = Area(Geometry=item_2)  # -> Area, Centroid
# Double facade
join_3 = BrepJoin(Breps=merge_3)  # -> Breps, Closed
scale_nu = ScaleNU(Geometry=join_3.Breps, Plane=area.Centroid, ScaleX=expression, ScaleY=expression, ScaleZ=1)  # -> simplify(Geometry), Transform

# ----
data_2 = Data(merge_2)
bbox_2 = BoundingBox(Content=data_2, Plane=PlaneXY(0, 0, 0), UnionBox=True)  # -> Box, Box_2
debrep_3 = DeconstructBrep(Brep=bbox_2.Box)  # -> Faces, Edges, Vertices
neg_3 = Negative(Value=Slider(0.7, range=0..10))
expression_2 = Expression(x=len, y=neg_3, Expression="(x/4+y*2)/(x/4)")
item_3 = ListItem(List=debrep_3.Faces, Index=4, Wrap=True)
area_2 = Area(Geometry=item_3)  # -> Area, Centroid
scale_nu_2 = ScaleNU(Geometry=data_2, Plane=area_2.Centroid, ScaleX=expression_2, ScaleY=expression_2, ScaleZ=1)  # -> simplify(Geometry), Transform
debrep_4 = DeconstructBrep(Brep=scale_nu_2.Geometry)  # -> Faces, Edges, Vertices
item_4 = ListItem(List=debrep_4.Edges, Index=0, Wrap=True)
item_5 = ListItem(List=debrep_4.Edges, Index=Slider(1, range=0..1), Wrap=True)
number_slider_7 = Slider(5, range=0..10)

# ---- group: Guide curve
item_6 = ListItem(List=debrep_4.Edges, Index=0, Wrap=True)
trim_4 = TrimTree(Tree=item_6, Depth=1)
join_4 = JoinCurves(Curves=trim_4, Preserve=False)
# Columns
center_3 = Center(Geometric=join_4)  # -> Center, Dimension
cir = Circle(Plane=center_3.Center, Radius=1)  # -> flatten(Circle)
item_7 = ListItem(List=cir, Index=0, Wrap=True)

# ----
c_script = CSharpScript(Curves=item_5, GuideCurve=item_7)  # -> out, simplify(CurvesOut); inputs Curves: list of Curve, GuideCurve: Curve
# ---------- c_script: C# ----------
    if (Curves == null || Curves.Count < 1 || GuideCurve==null) return;
    OrientCurves(Curves, GuideCurve);
    CurvesOut = Curves;
# ---------- c_script: C# additional code ----------
  private void OrientCurves(List<Curve> Curves, Curve GuideCurve)
  {
    for (int i = 0; i < Curves.Count; i++)
    {
      Curve curve = Curves[i];
      Point3d pointOnCurve;
      Point3d pointOnGuideCrv;
      if (curve.ClosestPoints(GuideCurve, out pointOnCurve, out pointOnGuideCrv))
      {
        double crvParameter;
        curve.ClosestPoint(pointOnCurve, out crvParameter);
        Vector3d curveTanget = curve.TangentAt(crvParameter);
        double guideCrvParameter;
        GuideCurve.ClosestPoint(pointOnGuideCrv, out guideCrvParameter);
        Vector3d guideTangent = GuideCurve.TangentAt(guideCrvParameter);
        double angleBtwTangents = Vector3d.VectorAngle(curveTanget, guideTangent);
        if (angleBtwTangents > Math.PI / 2)
        {
          Curves[i].Reverse();
        }
      }
    }
  }
# ---------- end c_script ----------
c_script_2 = CSharpScript(Curves=item_4, GuideCurve=item_7)  # -> out, simplify(CurvesOut); inputs Curves: list of Curve, GuideCurve: Curve; same code as c_script

divide = DivideCurve(Curve=c_script_2.CurvesOut, Count=number_slider_7, Kinks=False)  # -> Points, Tangents, Parameters
divide_2 = DivideCurve(Curve=c_script.CurvesOut, Count=number_slider_7, Kinks=False)  # -> Points, Tangents, Parameters
ln_3 = Line(StartPoint=divide_2.Points, EndPoint=divide.Points)
trim_5 = TrimTree(Tree=ln_3, Depth="2")
flip_3 = FlipMatrix(Data=trim_5)
join_5 = JoinCurves(Curves=flip_3, Preserve=False)

# ---- group: Facade
debrep_5 = DeconstructBrep(Brep=data_2)  # -> Faces, Edges, Vertices
item_8 = ListItem(List=debrep_5.Edges, Index=0, Wrap=True)
c_script_3 = CSharpScript(Curves=item_8, GuideCurve={Plane=PlaneXY(255.317773, -76.76863578, 0), Radius=1})  # -> out, simplify(CurvesOut); inputs Curves: list of Curve, GuideCurve: Curve; same code as c_script
trim_6 = TrimTree(Tree=c_script_3.CurvesOut, Depth=1)
viewer_7 = ParamViewer(trim_6)
item_9 = ListItem(List=viewer_7, Index=0, Wrap=True)
branch_7 = TreeBranch(Tree=trim_6, Path=item_9, MaintainPaths=True)
number_slider_8 = Slider(10, range=0..10)
subtraction = Subtraction(A=number_slider_5, B=0.05)

# ----
join_6 = JoinCurves(Curves=trim_6, Preserve=False)
center_4 = Center(Geometric=join_6)  # -> Center, Dimension
project = Project(Geometry=branch_7, Plane=PlaneXY(0, 0, 0))  # -> Geometry, Transform
pdecon = Deconstruct(Point=center_4.Center)  # -> XComponent, YComponent, ZComponent
Z_4 = UnitZ(Factor=pdecon.ZComponent)
move_2 = Move(Geometry=project.Geometry, Motion=Z_4)  # -> Geometry, Transform
gate = StreamGate(Stream=move_2.Geometry, Gate=toggle)  # -> Target0, Target1

# ---- group: Facade (continued)
ext = ExtendCurve(Curve=move_2.Geometry, Type=0, Start=number_slider_8, End=number_slider_8)  # -> graft(Curve)
divdist = DivideDistance(Curve=ext, Distance=number_slider_4)  # -> Points, Tangents, Parameters
pframe = PerpFrame(Curve=ext, Parameter=divdist.Parameters)  # -> simplify(Frame)
cir_2 = Circle(Plane=pframe, Radius=100)
bbx = BrepBrep(BrepA=cir_2, BrepB=debrep_5.Faces)  # -> simplify(Curves), Points
# Facade structure
graft_2 = GraftTree(Tree=gate.Target0, IncludeEmptyLists=True, IncludeNullItems=True)
pframe_2 = PerpFrame(Curve=graft_2, Parameter=0)
deplane = DeconstructPlane(Plane=pframe_2)  # -> Origin, XAxis, YAxis, ZAxis
amp = Amplitude(Vector=expr("-x", deplane.YAxis), Amplitude=subtraction)
amp_2 = Amplitude(Vector=deplane.YAxis, Amplitude=0.05)

# ----
gate_2 = StreamGate(Stream=bbx.Curves, Gate=toggle)  # -> Target0, Target1

# ---- group: Facade (continued)
clean = CleanTree(RemoveNulls=True, RemoveInvalid=True, RemoveEmpty=True, Tree=gate_2.Target0)
trim_7 = TrimTree(Tree=clean, Depth=1)
move_3 = Move(Geometry=trim_7, Motion=amp)  # -> Geometry, Transform
move_4 = Move(Geometry=trim_7, Motion=amp_2)  # -> Geometry, Transform
graft_3 = GraftTree(Tree=move_4.Geometry, IncludeEmptyLists=True, IncludeNullItems=True)
graft_4 = GraftTree(Tree=move_3.Geometry, IncludeEmptyLists=True, IncludeNullItems=True)
loft_2 = Loft(
    Curves=[graft_4, graft_3],
    Options={Adjust=False, Closed=False, LoftEnds=0, LoftSimp=0, LoftType=0, Rebuild=10, Refit=0.01})
center_5 = Center(Geometric=loft_2)  # -> Center, Dimension
evalsrf = EvaluateSurface(Surface=loft_2, Point=center_5.Center)  # -> Point, Normal, UDirection, VDirection, Frame
amp_3 = Amplitude(Vector=evalsrf.Normal, Amplitude=number_slider_6)
move_5 = Move(Geometry=loft_2, Motion=amp_3)  # -> Geometry, Transform
extr_2 = Extrude(Base=move_5.Geometry, Direction=expr("-x*2", amp_3))
